# Grasshopper definition AIA_UBREM_Hops.gh (Grasshopper 1.0.7)
# plug-ins: Hops

number_slider = Slider(1, range=0..10)
number_slider_2 = Slider(1.2, range=0..10)
number_slider_3 = Slider(1.2, range=0..10)
number_slider_4 = Slider(1.2, range=0..10)
number_slider_5 = Slider(345.987, range=0..1000)
number_slider_6 = Slider(1.2, range=0..10)
number_slider_7 = Slider(1.7, range=0..10)
concatenate = Concatenate(FragmentA="http://a3fb-34-80-80-111.ngrok.io", FragmentB="/BuildingsEnergy")
hops = Hops(
    _Path=concatenate,
    Area=Slider(345.546, range=0..1000),
    Bdgcode=Slider(2, range=0..10),
    U_value_walls_W_per_m2K=Slider(3, range=0..10),
    U_value_roof_W_per_m2K=Slider(3, range=0..10),
    U_value_basement_W_per_m2K=Slider(3, range=0..10),
    U_value_glass_W_per_m2K=Slider(3, range=0..10),
    G_value_glass_W_per_m2K=Slider(1, range=0..10),
    CacheResultsInMemory=False,
    CacheSolveResults=False,
    RemoteDefinitionLocation="http://a3fb-34-80-80-111.ngrok.io/BuildingsEnergy",
    RemoteSolveVersion=(0, 1, 0),
    ShowInput_Enabled=False,
    ShowInput_Path=True,
    SynchronousSolve=True)  # -> Heating_energy_kWh_per_m2_a, Cooling_energy_kWh_per_m2_a, DHW_energy_kWh_per_m2_a, Total_energy_kWh_per_m2_a
panel = Panel(hops.Heating_energy_kWh_per_m2_a)
